# Grasshopper definition automate02.gh (Grasshopper 1.0.7)

number_slider = Slider(30, range=0..30)
neg = Negative(Value=number_slider)
dom = ConstructDomain(DomainStart=number_slider, DomainEnd=neg)
number_slider_2 = Slider(20, range=0..20)
number_slider_3 = Slider(2, range=0..10)
rectangle = Rectangle(Plane=PlaneXY(0, 0, 0), XSize=dom, YSize=dom, Radius=0)  # -> Rectangle, Length
rectangle_2 = Rectangle(Plane=PlaneXY(0, 0, 0), XSize=Slider(10, range=0..10), YSize=Slider(10, range=0..10), Radius=0)  # -> Rectangle, Length
mplane = MeshPlane(Boundary=rectangle_2.Rectangle, WidthCount=number_slider_3, HeightCount=number_slider_3)  # -> Mesh, Area
b2 = GetInteger(Slider(1, range=1..10), AtLeast=1, AtMost=1, Maximum=2147483647, Minimum=-2147483648, TreeAccess=False)
b1 = GetInteger(Slider(1, range=1..10), AtLeast=1, AtMost=1, Maximum=2147483647, Minimum=-2147483648, TreeAccess=False)
b3 = GetInteger(Slider(1, range=1..10), AtLeast=1, AtMost=1, Maximum=2147483647, Minimum=-2147483648, TreeAccess=False)
mplane_2 = MeshPlane(Boundary=rectangle.Rectangle, WidthCount=number_slider_2, HeightCount=number_slider_2)  # -> Mesh, Area
b4 = GetInteger(Slider(1, range=1..10), AtLeast=1, AtMost=1, Maximum=2147483647, Minimum=-2147483648, TreeAccess=False)
md_slider = MDSlider(
    SliderMode=0,
    slider_value=Point(0.6312611247, 0.723759721, 0.5),
    x_domain=Domain(0, 1),
    y_domain=Domain(0, 1),
    z_domain=Domain(0, 1))
faceb = FaceBoundaries(Mesh=mplane.Mesh)
pt = ConstructPoint(XCoordinate=0, YCoordinate=0, ZCoordinate=0)
demesh = DeconstructMesh(Mesh=mplane_2.Mesh)  # -> Vertices, Faces, Colours, Normals
Z = UnitZ(Factor=b1)
Z_2 = UnitZ(Factor=b2)
Z_3 = UnitZ(Factor=b3)
Z_4 = UnitZ(Factor=b4)
sph = Sphere(Base=pt, Radius=1)
conmesh = ConstructMesh(Vertices=demesh.Vertices, Faces=graft(demesh.Faces))
extr = Extrude(Base=faceb, Direction=[Z, Z_2, Z_3, Z_4])
evalsrf = EvaluateSurface(Surface=reparameterize(sph), Point=md_slider)  # -> Point, Normal, UDirection, VDirection, Frame
area = Area(Geometry=conmesh)  # -> Area, Centroid
cap = CapHoles(Brep=extr)
vec2pt = Vector2Pt(PointA=pt, PointB=evalsrf.Point, Unitize=False)  # -> Vector, Length
smesh = SimpleMesh(Brep=cap)
vdis = VectorDisplay(Anchor=pt, Vector=vec2pt.Vector)
mjoin = MeshJoin(Meshes=smesh)
meshray = MeshRay(Mesh=mjoin, Point=area.Centroid, Direction=vec2pt.Vector)  # -> Point, Hit
cull = CullPattern(List=conmesh, CullPattern=invert(meshray.Hit))
cull_2 = CullPattern(List=conmesh, CullPattern=meshray.Hit)
lng = ListLength(List=flatten(conmesh))
lng_2 = ListLength(List=flatten(cull_2))
volume = Volume(Geometry=mjoin)  # -> Volume, Centroid
preview = CustomPreview(Geometry=cull_2, Material=ColourSwatch(SwatchColor=RGB(0, 0, 0)))
division = Division(A=lng_2, B=lng)
preview_2 = CustomPreview(Geometry=cull, Material=ColourSwatch(SwatchColor=RGB(255, 255, 255)))
panel = Panel(volume.Volume)
ratio = ContextPrint(Ratio=division)
context_print = ContextPrint(Text=volume.Volume)
panel_2 = Panel(division)
